# Grasshopper definition Roman_submission_term1_CUD_02.gh (Grasshopper 1.0.7)
# plug-ins: Geospatial, Urbano, Hops, horsterCameraControl, Human, Wombat

# ----
# hidrated lime mines
path = FilePath("C:\WORK_IAAC\submissions\Computational design I\lime production - Sheet1.csv")
file = ReadFile(File=path, PerLineParse=True)

split = TextSplit(Text=file, Separators=";")

# ----
# hemp producers
path_2 = FilePath("C:\WORK_IAAC\submissions\Computational design I\hemp production - Sheet1.csv")
file_2 = ReadFile(File=path_2, PerLineParse=True)

split_2 = SplitList(List=flatten(split), Index=1)  # -> ListA, ListB

# ----
# cull closest anchor points
panel = Panel("""0
3
7
8
9
10
13
14
15
16
17
21
22
24
27
28
29
30
35
39
40
41
44
45
49""")
cull_i = CullIndex(List=split_2.ListB, Indices=panel, Wrap=True)
lng = ListLength(List=panel)
panel_2 = Panel(lng)

split_3 = TextSplit(Text=file_2, Separators=";")
split_4 = SplitList(List=flatten(split_3), Index=1)  # -> ListA, ListB
panel_3 = Panel("del")
number_slider = Slider(27, range=0..27)
split_5 = TextSplit(Text=split_4.ListA, Separators=",")
split_6 = TextSplit(Text=split_4.ListB, Separators=",")
split_7 = TextSplit(Text=split_2.ListA, Separators=",")
split_8 = TextSplit(Text=cull_i, Separators=",")

# ----
# not working well(
# automate saving screenshots
panel_4 = Panel("D:\WORK IAAC\submissions\Computational design\Sub_2_sites\")
concat = Concatenate(FragmentA="limesite_", FragmentB=number_slider, FragmentC=".jpg")
concat_2 = Concatenate(FragmentA=panel_4, FragmentB=concat)
saveview = SaveViewportToFile(Run=Toggle(False), ViewportName="top", Render=False, FilePath=concat_2, ScaleFactor=2)

meta = CreateMetadata(KeysInMetadata=split_5, ValuesInMetadata=split_6)

# ----
# slide names hemp
number_slider_2 = Slider(1, range=0..12)
item = ListItem(List=split_5, Index=[number_slider_2, Slider(7, range=0..12), Slider(8, range=0..12)], Wrap=True)
panel_5 = Panel(item)
lookup = LookupMetadata(MetadataGeometry=meta, SearchKey=panel_5)  # -> simplify(Value)

item_2 = ListItem(List=split_5, Index=Slider(10, range=0..12), Wrap=True)
meta_2 = CreateMetadata(KeysInMetadata=split_7, ValuesInMetadata=split_8)

# ----
# slide names lime
number_slider_3 = Slider(1, range=0..12)
item_3 = ListItem(List=split_7, Index=[number_slider_3, Slider(3, range=0..12), Slider(4, range=0..12)], Wrap=True)
panel_6 = Panel(item_3)
lookup_2 = LookupMetadata(MetadataGeometry=meta_2, SearchKey=panel_6)  # -> simplify(Value)

item_4 = ListItem(List=split_7, Index=Slider(6, range=0..10), Wrap=True)
item_5 = ListItem(List=split_5, Index=Slider(11, range=0..12), Wrap=True)
item_6 = ListItem(List=split_7, Index=Slider(7, range=0..10), Wrap=True)
panel_7 = Panel("""0
3""")
panel_8 = Panel(item_2)
panel_9 = Panel(item_4)
panel_10 = Panel(item_5)
panel_11 = Panel(item_6)
lookup_3 = LookupMetadata(MetadataGeometry=meta, SearchKey=panel_8)  # -> flatten(Value)
lookup_4 = LookupMetadata(MetadataGeometry=meta, SearchKey=panel_10)  # -> flatten(Value)
lookup_5 = LookupMetadata(MetadataGeometry=meta_2, SearchKey=panel_9)  # -> flatten(Value)
lookup_6 = LookupMetadata(MetadataGeometry=meta_2, SearchKey=panel_11)  # -> flatten(Value)

# ----
# 50-100-150km accesibility
series = Series(Start="200", Step="150", Count=3)
panel_12 = Panel(series)
division = Division(A=panel_12, B=100)  # -> graft(Result)

panel_13 = Panel(lookup_3)
hemp_builders = ConstructPoint(XCoordinate=lookup_4, YCoordinate=lookup_3, ZCoordinate=0)
switch_data = Data(lookup_2)

# ----
# put names on slide
concat_3 = Concatenate(FragmentA="{", FragmentB=number_slider, FragmentC="}")
panel_14 = Panel(concat_3)
branch = TreeBranch(Tree=switch_data, Path=panel_14, MaintainPaths=True)
panel_15 = Panel(branch)
item_7 = ListItem(List=panel_15, Index=0, Wrap=True)  # -> Item, Item1, Item2
concat_4 = Concatenate(FragmentA=item_7.Item, FragmentC=". ", FragmentB=item_7.Item2)
panel_16 = Panel([concat_4, item_7.Item1])
dispatch = Dispatch(List=panel_16, DispatchPattern=[True, False])  # -> ListA, ListB

lime_mines = ConstructPoint(XCoordinate=lookup_6, YCoordinate=lookup_5, ZCoordinate=0)
swatch = ColourSwatch(SwatchColor=RGB(255, 255, 255))
points = PointList(Points=lime_mines, Size=0.5)
cir = Circle(Plane=hemp_builders, Radius=division)
cir_2 = Circle(Plane=lime_mines, Radius=division)
panel_17 = Panel(lookup_5)
panel_18 = Panel(split)

# ----
# resulting anchor points
flip = FlipMatrix(Data=cir)
flip_2 = FlipMatrix(Data=cir_2)
item_8 = ListItem(List=flip_2, Index=0, Wrap=True)  # -> Item, Item1, Item2
item_9 = ListItem(List=flip, Index=0, Wrap=True)  # -> Item, Item1, Item2

number_slider_4 = Slider(4, range=0..5)
# generate selection of isochrones
number_slider_5 = Slider(50, range=0..100)

series_2 = Series(Start=0, Step=1, Count=number_slider_4)
concat_5 = Concatenate(FragmentA="{", FragmentB=series_2, FragmentC="}")
panel_19 = Panel(concat_5)

panel_20 = Panel(split_8)
switch_areas = Geometry(item_8.Item)

dam = DataDam(DataA=flatten(switch_areas), BufferDelay=10000000, BufferMode=0)
item_10 = ListItem(List=dam, Index=number_slider, Wrap=True)
cpoly = ControlPolygon(Curve=item_10)  # -> Polygon, Points
lng_2 = ListLength(List=dam)
disc = Discontinuity(Curve=cpoly.Polygon, Level=1)  # -> Points, Parameters
panel_21 = Panel(lng_2)
pt = Point(disc.Points)

# ----
# automate camera focus
number_slider_6 = Slider(500, range=0..1000)
animate = Slider(0.025, range=0..1)
number_slider_7 = Slider(100000, range=0..100000)
number_slider_8 = Slider(8, range=0..10)
area = Area(Geometry=item_10)  # -> Area, Centroid
Z = UnitZ(Factor=number_slider_6)
move = Move(Geometry=area.Centroid, Motion=Z)  # -> Geometry, Transform
Y = UnitY(Factor=1)
setcam = SetCamera(CameraLocation=move.Geometry, TargetLocation=area.Centroid, LensLength=animate, UpDirection=Y, Activate=Toggle(False))

# ----
# .../ee_cumCost
hops = Hops(
    Layer="Oxford/MAP/friction_surface_2019",
    Cost="friction",
    Sources=item_10,
    Maxdistance=Slider(200000, range=0..200000),
    Scale=Slider(1000, range=0..1000),
    Bbox=pt,
    CacheResultsInMemory=True,
    CacheSolveResults=True,
    RemoteDefinitionLocation="http://127.0.0.1:5000/ee_cumCost",
    RemoteSolveVersion=(0, 1, 0),
    ShowInput_Enabled=False,
    ShowInput_Path=False,
    SynchronousSolve=False)  # -> Values, W, H

# ----
# .../reproject_UTM
hops_2 = Hops(
    Points=pt,
    Bool=Toggle(False),
    CacheResultsInMemory=True,
    CacheSolveResults=True,
    RemoteDefinitionLocation="http://127.0.0.1:5000/reproject_UTM",
    RemoteSolveVersion=(0, 1, 0),
    ShowInput_Enabled=False,
    ShowInput_Path=False,
    SynchronousSolve=True)  # disabled

pline = PolyLine(Vertices=reverse(hops_2), Closed=invert(False))

# ----
# placing names of isocurves centers
item_11 = ListItem(List=pt, Index=0, Wrap=True)  # -> Item, Item1, Item2, Item3
Y_2 = UnitY(Factor=50)
ln = Line(StartPoint=item_11.Item2, EndPoint=item_11.Item3)
move_2 = Move(Geometry=item_11.Item2, Motion=Y_2)  # -> Geometry, Transform
midpt = CurveMiddle(Curve=ln)
swatch_2 = ColourSwatch(SwatchColor=RGB(255, 255, 255))
pl_3pt = Plane3Pt(PointA=midpt, PointB=item_11.Item3, PointC=move_2.Geometry)
Y_3 = UnitY(Factor=expr("x/2", "0.1"))
move_3 = Move(Geometry=pl_3pt, Motion=expr("-x", Y_3))  # -> Geometry, Transform
move_4 = Move(Geometry=move_3.Geometry, Motion=expr("-x*4", Y_3))  # -> Geometry, Transform
justified_text = JustifiedText3d(
    Location=move_3.Geometry,
    Text=dispatch.ListA,
    Size="0.1",
    Color=swatch_2,
    HorizontalAlignment=1,
    VerticalAlginment=2,
    UseMeshes=False,
    Bake=False)
justified_text_2 = JustifiedText3d(
    Location=move_4.Geometry,
    Text=dispatch.ListB,
    Size="0.1",
    Color=swatch_2,
    HorizontalAlignment=1,
    VerticalAlginment=2,
    UseMeshes=False,
    Bake=False)

pt_2 = Point(cpoly.Points)
bnd = Bounds(Numbers=hops.Values)

# ----
# right textframe
item_12 = ListItem(List=pt_2, Index=7, Wrap=True)
pdecon = Deconstruct(Point=item_12)  # -> XComponent, YComponent, ZComponent
pt_3 = ConstructPoint(XCoordinate=pdecon.XComponent, YCoordinate=expr("x-0.05", pdecon.YComponent), ZCoordinate=200)

# ----
# left textframe
item_13 = ListItem(List=pt_2, Index=5, Wrap=True)
pdecon_2 = Deconstruct(Point=item_13)  # -> XComponent, YComponent, ZComponent
pt_4 = ConstructPoint(XCoordinate=pdecon_2.XComponent, YCoordinate=expr("x-0.05", pdecon_2.YComponent), ZCoordinate=200)

mplane = MeshPlane(Boundary=cpoly.Polygon, WidthCount=hops.W, HeightCount=hops.H)  # -> Mesh, Area
dedomain = DeconstructDomain(Domain=bnd)  # -> Start, End
gradient = Gradient(
    LowerLimit=dedomain.Start,
    UpperLimit=Slider(191, range=0..200),
    Parameter=hops.Values,
    stops=[0: RGB(234, 38, 0), 0.25: RGB(234, 126, 0), 0.5: RGB(254, 244, 84), 0.75: RGB(173, 203, 249), 1: RGB(75, 107, 169)])
demesh = DeconstructMesh(Mesh=mplane.Mesh)  # -> Vertices, Faces, Colours, Normals
Z_2 = UnitZ(Factor=hops.Values)
move_5 = Move(Geometry=demesh.Vertices, Motion=Z_2)  # -> Geometry, Transform
conmesh = ConstructMesh(Vertices=move_5.Geometry, Faces=demesh.Faces, Colours=gradient)
contour = Contour(Shape=conmesh, Point=Point(0, 0, 1), Direction=Vector(0, 0, 1), Distance=number_slider_5)  # -> simplify(Contours)
preview = CustomPreview(Geometry=contour, Material=ColourSwatch(SwatchColor=RGB(38, 3, 3)))
branch_2 = TreeBranch(Tree=contour, Path=panel_19, MaintainPaths=True)
item_14 = ListItem(List=branch_2, Index=0, Wrap=True)
close = CloseCurve(Curve=item_14, Tolerance=0)

# ----
# calculate areas
area_2 = Area(Geometry=close)  # -> expr("x*1000", Area), Centroid
int = Integer(area_2.Area)
panel_22 = Panel(int)
larger = LargerThan(FirstNumber=panel_22, SecondNumber=0)  # -> LargerThan, OrEqualTo
panel_23 = Panel(larger.LargerThan)
cull = CullPattern(List=panel_22, CullPattern=panel_23)
concat_6 = Concatenate(FragmentA=cull, FragmentB=" km2")

# ----
# setting points for areas numbers
number_slider_9 = Slider(0.036, range=0..1)
deg = Degrees(Radians=number_slider_9)
reb = RebuildCurve(Curve=item_14, Degree=deg, Count=10, Tangents=False)
offset = OffsetCurve(Curve=reb, Distance=Slider(0.138, range=0..1), Plane=area_2.Centroid, Corners=3)
eval = EvaluateCurve(Curve=reparameterize(offset), Parameter=Slider(0.436, range=0..1))  # -> Point, Tangent, Angle

# ----
# calculation of farest destination point within ranges
divide = DivideCurve(Curve=reb, Count=20, Kinks=False)  # -> Points, Tangents, Parameters
dist = Distance(PointA=area_2.Centroid, PointB=divide.Points)
sort = SortList(Keys=dist, ValuesA=divide.Points)  # -> Keys, ValuesA
bnd_2 = Bounds(Numbers=sort.ValuesA)
dedomain_2 = DeconstructDomain(Domain=bnd_2)  # -> Start, End
multiplication = Multiplication(A=dedomain_2.End, B=100)
int_2 = Integer(multiplication)
panel_24 = Panel(int_2)

# ----
# change Z for text points to be visible
pdecon_3 = Deconstruct(Point=area_2.Centroid)  # -> XComponent, YComponent, ZComponent
pdecon_4 = Deconstruct(Point=eval.Point)  # -> XComponent, YComponent, ZComponent
sort_2 = SortList(Keys=flatten(pdecon_3.ZComponent), ValuesA=flatten(area_2.Centroid))  # -> Keys, reverse(ValuesA)
item_15 = ListItem(List=sort_2.ValuesA, Index=0, Wrap=True)
pt_5 = ConstructPoint(XCoordinate=pdecon_4.XComponent, YCoordinate=pdecon_4.YComponent, ZCoordinate=item_15)
pt_6 = Point(pt_5)

# ----
# Ukraine NUTS 2
path_3 = FilePath("C:\WORK_IAAC\submissions\Computational design I\ua_2.geojson")
readjson = ReadGeoJSON(File=path_3)  # -> Type, simplify(Geometry), Keys, Values
meta_3 = CreateMetadata(KeysInMetadata=readjson.Keys, ValuesInMetadata=simplify(readjson.Values))
branch_3 = TreeBranch(Tree=simplify(readjson.Keys), Path="{0}", MaintainPaths=True)
panel_25 = Panel(branch_3)
item_16 = ListItem(List=panel_25, Index=0, Wrap=True)
lookup_7 = LookupMetadata(MetadataGeometry=meta_3, SearchKey=item_16)  # -> flatten(Value)
panel_26 = Panel(lookup_7)

path_mapper = PathMapper(readjson.Geometry, source=["{A}", "{A;B}"], target=["{A}", "{A}"])

crv = Curve(path_mapper)

# ----
# selection countries and centroids
area_3 = Area(Geometry=crv)  # -> Area, Centroid
sort_3 = SortList(Keys=area_3.Area, ValuesA=crv)  # -> flatten(Keys), ValuesA
item_17 = ListItem(List=reverse(sort_3.ValuesA), Index=0, Wrap=False)  # -> flatten(Item)
area_4 = Area(Geometry=item_17)  # -> Area, Centroid

# ----
# EU NUTS 2
path_4 = FilePath("C:\WORK_IAAC\submissions\Computational design I\eu_2.geojson")
readjson_2 = ReadGeoJSON(File=path_4)  # -> Type, simplify(Geometry), Keys, Values
meta_4 = CreateMetadata(KeysInMetadata=readjson_2.Keys, ValuesInMetadata=simplify(readjson_2.Values))
branch_4 = TreeBranch(Tree=simplify(readjson_2.Keys), Path="{0}", MaintainPaths=True)
panel_27 = Panel(branch_4)
item_18 = ListItem(List=panel_27, Index=Slider(3, range=0..10), Wrap=True)

viewer = ParamViewer(readjson_2.Geometry)
path_mapper_2 = PathMapper(readjson_2.Geometry, source=["{A}", "{A;B}"], target=["{A}", "{A}"])
viewer_2 = ParamViewer(path_mapper_2)
panel_28 = Panel(item_18)

crv_2 = Curve(path_mapper_2)
lookup_8 = LookupMetadata(MetadataGeometry=meta_4, SearchKey=panel_28)  # -> flatten(Value)
panel_29 = Panel(lookup_8)

mindex = MemberIndex(Set=lookup_8, Member="DE")  # -> Index, Count

# ----
# correct names
panel_30 = Panel("Prov.")
rep = ReplaceText(Text=panel_29, Find=panel_30, Replace=" ", RecursiveReplace=False)
rep_2 = ReplaceText(Text=rep, Find="Ã¨", Replace="è", RecursiveReplace=False)
rep_3 = ReplaceText(Text=rep_2, Find="Ã¼", Replace="ü", RecursiveReplace=False)
rep_4 = ReplaceText(Text=rep_3, Find="Ã¤", Replace="ä", RecursiveReplace=False)
rep_5 = ReplaceText(Text=rep_4, Find="Ã¶", Replace="ö", RecursiveReplace=False)
rep_6 = ReplaceText(Text=rep_5, Find="Ã©", Replace="é", RecursiveReplace=False)
rep_7 = ReplaceText(Text=rep_6, Find="Ã¡", Replace="á", RecursiveReplace=False)
rep_8 = ReplaceText(Text=rep_7, Find="Ãº", Replace="ú", RecursiveReplace=False)
rep_9 = ReplaceText(Text=rep_8, Find="Ã½", Replace="ý", RecursiveReplace=False)
rep_10 = ReplaceText(Text=rep_9, Find="Ã³", Replace="ó", RecursiveReplace=False)
rep_11 = ReplaceText(Text=rep_10, Find="Ä", Replace="ę", RecursiveReplace=False)
rep_12 = ReplaceText(Text=rep_11, Find="Å", Replace="Ś", RecursiveReplace=False)
rep_13 = ReplaceText(Text=rep_12, Find="Ãº", Replace="ú", RecursiveReplace=False)
rep_14 = ReplaceText(Text=rep_13, Find="Ã½", Replace="ý", RecursiveReplace=False)
rep_15 = ReplaceText(Text=rep_14, Find="Ã³", Replace="ó", RecursiveReplace=False)

# ----
# selection countries and centroids
area_5 = Area(Geometry=crv_2)  # -> Area, Centroid
sort_4 = SortList(Keys=area_5.Area, ValuesA=crv_2)  # -> flatten(Keys), ValuesA
item_19 = ListItem(List=reverse(sort_4.ValuesA), Index=0, Wrap=False)  # -> flatten(Item)
area_6 = Area(Geometry=item_19)  # -> Area, Centroid

# ----
# place regions names on map
number_slider_10 = Slider(0.07, range=0..1)
justified_text_3 = JustifiedText3d(
    Location=area_6.Centroid,
    Text=rep_15,
    Size=number_slider_10,
    HorizontalAlignment=1,
    VerticalAlginment=1,
    UseMeshes=False,
    Bake=False)
justified_text_4 = JustifiedText3d(
    Location=area_4.Centroid,
    Text=panel_26,
    Size=number_slider_10,
    HorizontalAlignment=1,
    VerticalAlginment=1,
    UseMeshes=False,
    Bake=False)

# ----
# bake isochrones
toggle = BooleanToggle(False)
createatts = CreateAttributes(LayerName="hemp", enableFullPath=False)
panel_31 = Panel("{2}")
branch_5 = TreeBranch(Tree=branch_2, Path="{3}", MaintainPaths=True)

item_20 = ListItem(List=branch_5, Index=panel_7, Wrap=True)  # -> Item, Item1, Item2
len = Length(Curve=branch_5)

movetoplane = MoveToPlane(Geometry=item_20.Item, Plane=PlaneXY(0, 0, 0), Above=True, Below=True)  # -> Geometry, Transform
bake = BakeGeometry(Bake=toggle, Geometry=movetoplane.Geometry, Attributes=createatts, DeleteOldBakes=False, PreserveTrees=False)

panel_32 = Panel(len)

# ----
# delivery areas data
int_3 = Integer(number_slider_4)
swatch_3 = ColourSwatch(SwatchColor=RGB(252, 252, 252))
series_3 = Series(Start=0, Step=expr("x*1.5", "0.05"), Count=int_3)
Y_4 = UnitY(Factor=expr("x/2", series_3))
move_6 = Move(Geometry=pt_4, Motion=expr("-x*2", Y_4))  # -> Geometry, Transform
move_7 = Move(Geometry=pt_3, Motion=expr("-x*2", Y_4))  # -> Geometry, Transform
justified_text_5 = JustifiedText3d(
    Location=move_7.Geometry,
    Text=flatten(concat_6),
    Size="0.05",
    Color=swatch_3,
    HorizontalAlignment=2,
    VerticalAlginment=1,
    UseMeshes=False,
    Bake=False)

# ----
# select type of engine g/l CO2
# liters per 100 km
https_ecoscore_be_en_info_ecoscore_co2 = ValueList({"diesel": 2640, "petrol": 2392, "LPG": 1665, "CNG": 2252}, selected="diesel")
kilometers_range = Panel(panel_24)
expression = Expression(x=https_ecoscore_be_en_info_ecoscore_co2, y=Slider(13, range=0..20), z=kilometers_range, Expression="x*y/100*z/1000")
kg_co2_km_produced = Panel(expression)
round = Round(Number=kg_co2_km_produced)  # -> Nearest, Floor, Ceiling
int_4 = Integer(round.Ceiling)

concat_7 = Concatenate(FragmentA=int_4, FragmentB=" kg CO2 max")

panel_33 = Panel(concat_7)

justified_text_6 = JustifiedText3d(
    Location=move_6.Geometry,
    Text=flatten(panel_33),
    Size=expr("x*0.85", "0.05"),
    Color=swatch_3,
    HorizontalAlignment=0,
    VerticalAlginment=1,
    UseMeshes=False,
    Bake=False)
