# Grasshopper definition Roman_submission_term1_CUD_02_stage_2.gh (Grasshopper 1.0.7)
# plug-ins: Hops, horsterCameraControl, Human, Geospatial, Urbano, Bifocals

# EU NUTS 0
path = FilePath("D:\WORK IAAC\submissions\Computational design\eu_0.geojson")

# ----
# embedded isochrone
#  areas from stage 1
crv = Curve([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])
crv_2 = Curve([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])

# ----
# simplify and complane curves
number_slider = Slider(0.147, range=0..1)
simplify = SimplifyCurve(Curve=crv_2, Tolerance=number_slider)  # -> Curve, Simplified
simplify_2 = SimplifyCurve(Curve=crv, Tolerance=number_slider)  # -> Curve, Simplified
deg = Degrees(Radians=Slider(8, range=0..90))
reb = RebuildCurve(Curve=simplify_2.Curve, Degree=deg, Count=50, Tangents=False)
reb_2 = RebuildCurve(Curve=simplify.Curve, Degree=deg, Count=50, Tangents=False)
movetoplane = MoveToPlane(Geometry=flatten(reb_2), Plane="0,0,0", Above=True, Below=True)  # -> Geometry, Transform
movetoplane_2 = MoveToPlane(Geometry=flatten(reb), Plane="0,0,0", Above=True, Below=True)  # -> Geometry, Transform

# ----
# boolean intersection between delivery areas of 2  material sources
boundary = BoundarySurfaces(Edges=movetoplane.Geometry)
boundary_2 = BoundarySurfaces(Edges=movetoplane_2.Geometry)
runion = RegionUnion(Curves=boundary_2)
runion_2 = RegionUnion(Curves=boundary)
rint = RegionIntersection(CurvesA=flatten(runion), CurvesB=graft(runion_2))  # -> simplify(Result)
srf = Surface(flatten(rint))
area = Area(Geometry=srf)  # -> Area, Centroid
larger = LargerThan(FirstNumber=area.Area, SecondNumber=Slider(0.786, range=0..1))  # -> LargerThan, OrEqualTo
cull = CullPattern(List=srf, CullPattern=larger.OrEqualTo)
srf_2 = Surface(cull)

item = ListItem(List=srf_2, Index=Slider(9, range=0..10), Wrap=True)
# show areas of overlapping with names
dam = DataDam(DataA=flatten(item), BufferDelay=10000000, BufferMode=0)

# ----
# filter largest areas
area_2 = Area(Geometry=srf_2)  # -> Area, Centroid
multiplication = Multiplication(A=area_2.Area, B="1000")
int = Integer(multiplication)
panel = Panel(int)

lng = ListLength(List=srf_2)
# switch off geomining for the all map
panel_2 = Panel("landcover")
panel_3 = Panel(lng)

# ----
# adjust boundary of Land Cover Analysis
bbox = BoundingBox(Content=dam, Plane=PlaneXY(0, 0, 0))  # -> Box, Box_2
edges = BrepEdges(Brep=bbox.Box)  # -> Naked, Interior, NonManifold
join = JoinCurves(Curves=edges.Naked, Preserve=invert(False))

disc = Discontinuity(Curve=join, Level=1)  # -> Points, Parameters

# ----
# .../ee_image
hops = Hops(
    Layer="COPERNICUS/CORINE/V20/100m/2012",
    Bands=panel_2,
    Mode="mode",
    Scale=Slider(1000, range=0..1000),
    Pts=disc.Points,
    CacheResultsInMemory=True,
    CacheSolveResults=True,
    RemoteDefinitionLocation="http://127.0.0.1:5000/ee_image",
    RemoteSolveVersion=(0, 1, 0),
    ShowInput_Enabled=False,
    ShowInput_Path=False,
    SynchronousSolve=False)  # -> Values, W, H; disabled

# ----
# automate camera focus
number_slider_2 = Slider(663, range=0..1000)
animate = Slider(0.023, range=0..1)
number_slider_3 = Slider(100000, range=0..100000)
number_slider_4 = Slider(8, range=0..10)
area_3 = Area(Geometry=join)  # -> Area, Centroid
Z = UnitZ(Factor=number_slider_2)
move = Move(Geometry=area_3.Centroid, Motion=Z)  # -> Geometry, Transform
Y = UnitY(Factor=1)
setcam = SetCamera(CameraLocation=move.Geometry, TargetLocation=area_3.Centroid, LensLength=animate, UpDirection=Y, Activate=Toggle(False))

# ----
# display boundary of overlapped delivery area
debrep = DeconstructBrep(Brep=item)  # -> Faces, Edges, Vertices
number_slider_5 = Slider(7, range=0..100)
swatch = ColourSwatch(SwatchColor=RGB(250, 239, 25))
previewlw = CustomPreviewLineweights(Geometry=debrep.Edges, Shader=swatch, Thickness=number_slider_5, Absolute=False)  # disabled

# ----
# display boundary of lime delivery areas
number_slider_6 = Slider(0.05, range=0..1)
debrep_2 = DeconstructBrep(Brep=runion_2)  # -> Faces, Edges, Vertices
join_2 = JoinCurves(Curves=flatten(debrep_2.Edges), Preserve=False)
number_slider_7 = Slider(3, range=0..100)
dash = DashPattern(Curve=join_2, Pattern=number_slider_6)  # -> Dashes, Gaps
swatch_2 = ColourSwatch(SwatchColor=RGB(250, 250, 230))
previewlw_2 = CustomPreviewLineweights(Geometry=dash.Dashes, Shader=swatch_2, Thickness=number_slider_7, Absolute=False)

# ----
# display boundary of hemp delivery areas
debrep_3 = DeconstructBrep(Brep=runion)  # -> Faces, Edges, Vertices
join_3 = JoinCurves(Curves=flatten(debrep_3.Edges), Preserve=False)
dash_2 = DashPattern(Curve=join_3, Pattern=number_slider_6)  # -> Dashes, Gaps
swatch_3 = ColourSwatch(SwatchColor=RGB(107, 250, 25))
previewlw_3 = CustomPreviewLineweights(Geometry=dash_2.Dashes, Shader=swatch_3, Thickness=number_slider_7, Absolute=False)

bnd = Bounds(Numbers=hops.Values)
dedomain = DeconstructDomain(Domain=bnd)  # -> Start, End
gradient = Gradient(
    LowerLimit=dedomain.Start,
    UpperLimit=dedomain.End,
    Parameter=hops.Values,
    stops=[0: RGB(243, 57, 0), 0.1: RGB(236, 27, 60), 0.2: RGB(210, 0, 118), 0.3: RGB(103, 0, 120), 0.4: RGB(39, 72, 161), 0.5: RGB(1, 192, 229), 0.6: RGB(18, 178, 90), 0.7: RGB(79, 186, 8), 0.8: RGB(220, 237, 32), 0.9: RGB(247, 159, 20), 1: RGB(0, 0, 0)])

mplane = MeshPlane(Boundary=join, WidthCount=hops.W, HeightCount=hops.H)  # -> Mesh, Area

demesh = DeconstructMesh(Mesh=mplane.Mesh)  # -> Vertices, Faces, Colours, Normals
conmesh = ConstructMesh(Vertices=demesh.Vertices, Faces=demesh.Faces, Colours=gradient)

# ----
# Dash lines
# BCN Base
# OPTIONAL SCATTERPLOT SHAPES
panel_4 = Panel(" hempcrete renovation within the 1.5-hours delivery area")
rec = Rectangle({Plane=PlaneXY(16.69404765, 52.31807592, 0), Size=Domain2(u=-28.86641634..28.86641634, v=-19.31761703..19.31761703)})
offset = OffsetCurve(Curve=rec, Distance="1", Corners=1)
srf_3 = Surface(srf_2)
pt = Point(area_2.Centroid)
explode = Explode(Curve=offset, Recursive=True)  # -> Segments, Vertices
item_2 = ListItem(List=explode.Segments, Index=0, Wrap=True)  # -> Item, Item1, Item2, Item3
pdecon = Deconstruct(Point=pt)  # -> XComponent, YComponent, ZComponent
area_4 = Area(Geometry=srf_3)  # -> Area, Centroid
midpt = CurveMiddle(Curve=item_2.Item1)
sort = SortList(Keys=pdecon.YComponent, ValuesA=area_4.Area)  # -> Keys, ValuesA
scale_nu = ScaleNU(Geometry=item_2.Item1, Plane=midpt, ScaleX=1, ScaleY=Slider(0.91, range=0..1), ScaleZ=1)  # -> Geometry, Transform
sort_2 = SortList(Keys=pdecon.YComponent, ValuesA=srf_2)  # -> Keys, ValuesA
sort_3 = SortList(Keys=pdecon.YComponent, ValuesA=pt)  # -> Keys, ValuesA
divide = DivideCurve(Curve=scale_nu.Geometry, Count=10, Kinks=False)  # -> Points, Tangents, Parameters
multiplication_2 = Multiplication(A=sort.ValuesA, B="1000")
panel_5 = Panel("""(FI) Länsi-Suomi
(DK) Central Denmark
(EI/UK)Eastern and Southern Ireland/ West Wales, Northern Ireland
(PL/ UA) Lublin/ Kovel
(BE/ NL/ FR/ DE/ LX) Belgium/ South Netherlands/ Picardie, Ardennes, Lorraine/ Koeln, Dusseldorf, Trier/ Luxembourg
(PL/ CZ) Opole, Silesia, Malopolska/ Moravskoslezský kraj
(PL/ CZ) Dolnośląskie/ Olomouc, Pardubice, Hradec Kralove
(DE/ FR/ CH/ AT) Bayern, Baden Württemberg/ Alsace/ Zurich, Ostschweiz/ Saltsburg, Oberösterreich
(UA) Dnipropetrovsk region
(AT/ SI/ HR/ HU) Steiermark, Kärnten/ Central, North, East Slovenia/ Sjeverna Hrvatska/ Nyugat-Dunántúl
(SR/ MK) South, East Serbia/ North-East Macedonia """)
int_2 = Integer(multiplication_2)
pdecon_2 = Deconstruct(Point=divide.Points)  # -> XComponent, YComponent, ZComponent
concat = Concatenate(FragmentA=int_2, FragmentB="km2")
lng_2 = ListLength(List=divide.Points)
panel_6 = Panel(pdecon_2.YComponent)
sort_4 = SortList(Keys=pdecon_2.YComponent, ValuesA=divide.Points)  # -> Keys, ValuesA
split = TextSplit(Text=panel_5, Separators=")")
dispatch = Dispatch(List=split, DispatchPattern=[True, False])  # -> ListA, ListB
bnd_2 = Bounds(Numbers=pdecon_2.YComponent)
swatch_4 = ColourSwatch(SwatchColor=RGB(28, 8, 8))
concat_2 = Concatenate(FragmentA=dispatch.ListA, FragmentB=")")
dedomain_2 = DeconstructDomain(Domain=bnd_2)  # -> Start, End
rev = ReverseList(List=flatten(dispatch.ListB))
panel_7 = Panel(rev)
rev_2 = ReverseList(List=flatten(concat_2))
gradient_2 = Gradient(
    LowerLimit=dedomain_2.Start,
    UpperLimit=dedomain_2.End,
    Parameter=pdecon_2.YComponent,
    stops=[0: RGB(0, 128, 0), 0.5: RGB(255, 255, 0), 1: RGB(255, 0, 0)])
split_2 = TextSplit(Text=panel_7, Separators="/")
lng_3 = ListLength(List=split_2)
previewmat = CustomPreviewMaterials(Geometry=sort_2.ValuesA, DiffuseColor=gradient_2, Transparency=Slider(0.52, range=0..1))
previewlw_4 = CustomPreviewLineweights(Geometry=rec, Shader=ColourSwatch(SwatchColor=RGB(0, 0, 0)), Thickness="2", Absolute=False)

# ----
# Ukraine NUTS 2
path_2 = FilePath("D:\WORK IAAC\submissions\Computational design\ua_2.geojson")
readjson = ReadGeoJSON(File=path_2)  # -> Type, simplify(Geometry), Keys, Values
meta = CreateMetadata(KeysInMetadata=readjson.Keys, ValuesInMetadata=simplify(readjson.Values))
branch = TreeBranch(Tree=simplify(readjson.Keys), Path="{0}", MaintainPaths=True)
panel_8 = Panel(branch)
item_3 = ListItem(List=panel_8, Index=0, Wrap=True)
lookup = LookupMetadata(MetadataGeometry=meta, SearchKey=item_3)  # -> flatten(Value)
panel_9 = Panel(lookup)

path_mapper = PathMapper(readjson.Geometry, source=["{A}", "{A;B}"], target=["{A}", "{A}"])

crv_3 = Curve(path_mapper)

# ----
# selection countries and centroids
area_5 = Area(Geometry=crv_3)  # -> Area, Centroid
sort_5 = SortList(Keys=area_5.Area, ValuesA=crv_3)  # -> flatten(Keys), ValuesA
item_4 = ListItem(List=reverse(sort_5.ValuesA), Index=0, Wrap=False)  # -> flatten(Item)
area_6 = Area(Geometry=item_4)  # -> Area, Centroid

# ----
# EU NUTS 2
path_3 = FilePath("D:\WORK IAAC\submissions\Computational design\eu_2.geojson")
readjson_2 = ReadGeoJSON(File=path_3, String="string", Mode=Toggle(False))  # -> Type, simplify(Geometry), Keys, Values
branch_2 = TreeBranch(Tree=simplify(readjson_2.Keys), Path="{0}", MaintainPaths=True)
meta_2 = CreateMetadata(KeysInMetadata=readjson_2.Keys, ValuesInMetadata=simplify(readjson_2.Values))
panel_10 = Panel(branch_2)
item_5 = ListItem(List=panel_10, Index=Slider(3, range=0..10), Wrap=True)

path_mapper_2 = PathMapper(readjson_2.Geometry, source=["{A}", "{A;B}"], target=["{A}", "{A}"])
geo = Geometry(path_mapper_2)
panel_11 = Panel(item_5)

lookup_2 = LookupMetadata(MetadataGeometry=meta_2, SearchKey=panel_11)  # -> flatten(Value)
# show names of NUTS 2
# show sqm of houses to renovate
panel_12 = Panel(lookup_2)

# ----
# correct names
panel_13 = Panel("Prov.")
rep = ReplaceText(Text=lookup_2, Find=panel_13, Replace=" ", RecursiveReplace=False)
rep_2 = ReplaceText(Text=rep, Find="Ã¨", Replace="è", RecursiveReplace=False)
rep_3 = ReplaceText(Text=rep_2, Find="Ã¼", Replace="ü", RecursiveReplace=False)
rep_4 = ReplaceText(Text=rep_3, Find="Ã¤", Replace="ä", RecursiveReplace=False)
rep_5 = ReplaceText(Text=rep_4, Find="Ã¶", Replace="ö", RecursiveReplace=False)
rep_6 = ReplaceText(Text=rep_5, Find="Ã©", Replace="é", RecursiveReplace=False)
rep_7 = ReplaceText(Text=rep_6, Find="Ã¡", Replace="á", RecursiveReplace=False)
rep_8 = ReplaceText(Text=rep_7, Find="Ãº", Replace="ú", RecursiveReplace=False)
rep_9 = ReplaceText(Text=rep_8, Find="Ã½", Replace="ý", RecursiveReplace=False)
rep_10 = ReplaceText(Text=rep_9, Find="Ã³", Replace="ó", RecursiveReplace=False)
rep_11 = ReplaceText(Text=rep_10, Find="Ä", Replace="ę", RecursiveReplace=False)
rep_12 = ReplaceText(Text=rep_11, Find="Å", Replace="Ś", RecursiveReplace=False)
rep_13 = ReplaceText(Text=rep_12, Find="Ãº", Replace="ú", RecursiveReplace=False)
rep_14 = ReplaceText(Text=rep_13, Find="Ã½", Replace="ý", RecursiveReplace=False)
rep_15 = ReplaceText(Text=rep_14, Find="Ã³", Replace="ó", RecursiveReplace=False)

# ----
# selection countries and centroids
area_7 = Area(Geometry=geo)  # -> Area, Centroid
sort_6 = SortList(Keys=area_7.Area, ValuesA=geo)  # -> flatten(Keys), ValuesA
item_6 = ListItem(List=reverse(sort_6.ValuesA), Index=0, Wrap=False)  # -> flatten(Item)
area_8 = Area(Geometry=item_6)  # -> Area, Centroid

# ----
# place regions names on map
number_slider_8 = Slider(0.07, range=0..1)
swatch_5 = ColourSwatch(SwatchColor=RGB(120, 120, 120))
justified_text = JustifiedText3d(
    Location=area_8.Centroid,
    Text=rep_15,
    Size=number_slider_8,
    Color=swatch_5,
    HorizontalAlignment=1,
    VerticalAlginment=1,
    UseMeshes=False,
    Bake=False)
justified_text_2 = JustifiedText3d(
    Location=area_6.Centroid,
    Text=panel_9,
    Size=number_slider_8,
    Color=swatch_5,
    HorizontalAlignment=1,
    VerticalAlginment=1,
    UseMeshes=False,
    Bake=False)

previewlw_5 = CustomPreviewLineweights(Geometry=flatten([geo, crv_3]), Shader=ColourSwatch(SwatchColor=RGB(102, 102, 102)), Thickness="1", Absolute=False)

# ---- group: .../reproject_UTM
reproj = Hops(
    Points=disc.Points,
    Bool=Toggle(False),
    CacheResultsInMemory=False,
    CacheSolveResults=False,
    RemoteDefinitionLocation="http://127.0.0.1:5000/reproject_UTM",
    RemoteSolveVersion=(0, 1, 0),
    ShowInput_Enabled=False,
    ShowInput_Path=False,
    SynchronousSolve=False)  # disabled

# ----
pline = PolyLine(Vertices=reverse(reproj), Closed=invert(False))

item_7 = ListItem(List=disc.Points, Index=1, Wrap=True)
Y_2 = UnitY(Factor=0.3)
swatch_6 = ColourSwatch(SwatchColor=RGB(250, 250, 230))
toggle = BooleanToggle(True)
move_2 = Move(Geometry=item_7, Motion=expr("-x", Y_2))  # -> Geometry, Transform

move_3 = Move(Geometry=move_2.Geometry, Motion=expr("-x/2", Y_2))  # -> Geometry, Transform
screentext = ScreenOrientedText(Text=panel_4, Justification=7, Location=move_3.Geometry, SizeFactor=0.1, Color=swatch_6, Depth=200, Absolute=toggle)

# ----
# place areas legend under each overlapped area
X = UnitX(Factor=move_2.Geometry)
line = LineSDL(Start=move_2.Geometry, Direction=X, Length=0.5)
X_2 = UnitX(Factor=number_slider_6)
dash_3 = DashPattern(Curve=line, Pattern=number_slider_6)  # -> Dashes, Gaps
Y_3 = UnitY(Factor=number_slider_8)
move_4 = Move(Geometry=dash_3.Dashes, Motion=expr("2.5*x", Y_3))  # -> Geometry, Transform
item_8 = ListItem(List=reverse(move_4.Geometry), Index=0, Wrap=True)
end = EndPoints(Curve=item_8)  # -> Start, End
move_5 = Move(Geometry=end.End, Motion=X_2)  # -> Geometry, Transform
screentext_2 = ScreenOrientedText(Text="hemp area", Justification=7, Location=move_5.Geometry, SizeFactor=0.07, Color=swatch_6, Depth=200, Absolute=toggle)
previewlw_6 = CustomPreviewLineweights(Geometry=move_4.Geometry, Shader=swatch_3, Thickness=number_slider_7, Absolute=False)
X_3 = UnitX(Factor=move_2.Geometry)
line_2 = LineSDL(Start=end.End, Direction=X_3, Length=0.5)
X_4 = UnitX(Factor=number_slider_6)
dash_4 = DashPattern(Curve=line_2, Pattern=number_slider_6)  # -> Dashes, Gaps
X_5 = UnitX(Factor=1)
move_6 = Move(Geometry=dash_4.Dashes, Motion=X_5)  # -> Geometry, Transform
item_9 = ListItem(List=reverse(move_6.Geometry), Index=0, Wrap=True)
end_2 = EndPoints(Curve=item_9)  # -> Start, End
move_7 = Move(Geometry=end_2.End, Motion=X_4)  # -> Geometry, Transform
previewlw_7 = CustomPreviewLineweights(Geometry=move_6.Geometry, Shader=swatch_2, Thickness=number_slider_7, Absolute=False)
screentext_3 = ScreenOrientedText(
    Text="hydrated lime area",
    Justification=7,
    Location=move_7.Geometry,
    SizeFactor=0.07,
    Color=swatch_6,
    Depth=200,
    Absolute=toggle)
X_6 = UnitX(Factor=move_2.Geometry)
line_3 = LineSDL(Start=end_2.End, Direction=X_6, Length=0.5)
X_7 = UnitX(Factor=number_slider_6)
X_8 = UnitX(Factor=1)
move_8 = Move(Geometry=line_3, Motion=X_8)  # -> Geometry, Transform
item_10 = ListItem(List=reverse(move_8.Geometry), Index=0, Wrap=True)
end_3 = EndPoints(Curve=item_10)  # -> Start, End
move_9 = Move(Geometry=end_3.End, Motion=X_7)  # -> Geometry, Transform
previewlw_8 = CustomPreviewLineweights(Geometry=move_8.Geometry, Shader=swatch, Thickness=number_slider_5, Absolute=False)
screentext_4 = ScreenOrientedText(
    Text="overplapping area",
    Justification=7,
    Location=move_9.Geometry,
    SizeFactor=0.07,
    Color=swatch_6,
    Depth=200,
    Absolute=toggle)

# ----
# culling land covers
# 111
# 112
# 
# https://land.copernicus.eu/user-corner/technical-library/corine-land-cover-nomenclature-guidelines/html/index-clc-111.html
number_slider_9 = Slider(121, range=111..511)
smaller = SmallerThan(FirstNumber=hops.Values, SecondNumber=number_slider_9)  # -> SmallerThan, OrEqualTo
not = GateNot(A=smaller.SmallerThan)
cullv = CullVertices(Mesh=conmesh, Pattern=not, Shrink=True)
mesh = Mesh(cullv)
medges = MeshEdges(Mesh=mesh)  # -> NakedEdges, InteriorEdges, NonManifoldEdges
join_4 = JoinCurves(Curves=medges.NakedEdges, Preserve=False)
boundary_3 = BoundarySurfaces(Edges=join_4)

# ----
# cleaning data for inclusion
area_9 = Area(Geometry=boundary_3)  # -> Area, Centroid
null = NullItem(Item=area_9.Centroid)  # -> NullFlags, InvalidFlags, Description
not_2 = GateNot(A=null.NullFlags)
cull_2 = CullPattern(List=area_9.Centroid, CullPattern=not_2)
incurve = PointInCurve(Point=cull_2, Curve=dam)  # -> Relationship, Point
cull_3 = CullPattern(List=boundary_3, CullPattern=not_2)
cull_4 = CullPattern(List=cull_3, CullPattern=incurve.Relationship)

area_10 = Area(Geometry=flatten(cull_4))  # -> Area, Centroid

multiplication_3 = Multiplication(A=area_10.Area, B="1000")
panel_14 = Panel(multiplication_3)

# ----
# calculate potential of sequestering CO2 emissions by hempcrete renovation within the delivery area
# define buildup area of residential plots
# define % of renovation need, sqm
# define % of hempcrete within renovation
# calculate CO2 potentially sequestered
ma = MassAddition(Input=panel_14)  # -> Result, PartialResults
sq_km_of_urban_fabric_inside_delivery_ar = Panel(ma.Result)  # "sq km of urban fabric inside delivery area"
renovation_need = Panel("10")
build_volume_ratio = Panel("3.5")
average_floors = Panel("3.5")
buildup = Panel("30")
# not working well(
co2_kg_by_1_m3_sequestered = Panel("165")
hempcrete = Panel("13")
correcting_factor = Panel("0.75")
expression = Expression(x=sq_km_of_urban_fabric_inside_delivery_ar, y=buildup, Expression="x*1000000/100*y")
int_3 = Integer(expression)
sqm = Panel(int_3)
https_www_renovate_europe_eu_wp_content = Expression(x=sqm, y=average_floors, z=renovation_need, Expression="x*y/100*z")  # "https://www.renovate-europe.eu/wp-content/uploads/2018/09/Renovate2Recover_Full-Study-1.pdf"
int_4 = Integer(https_www_renovate_europe_eu_wp_content)
sqm_2 = Panel(int_4)
expression_2 = Expression(x=sqm_2, y=build_volume_ratio, z=hempcrete, Expression="x*y/100*z")
int_5 = Integer(expression_2)
m3 = Panel(int_5)
expression_3 = Expression(x=m3, y=correcting_factor, z=co2_kg_by_1_m3_sequestered, Expression="x*y*z/1000")
int_6 = Integer(expression_3)
tonnes_of_co2_sequestered = Panel(int_6)

concat_3 = Concatenate(FragmentA=tonnes_of_co2_sequestered, FragmentB=" tonnes of sequestered CO2 is the potential of ")
panel_15 = Panel(concat_3)

screentext_5 = ScreenOrientedText(Text=panel_15, Justification=7, Location=move_2.Geometry, SizeFactor=0.1, Color=swatch_6, Depth=200, Absolute=toggle)

number_slider_10 = Slider(11.84, range=0..20)
pt_2 = Point(sort_3.ValuesA)
pt_3 = Point(sort_4.ValuesA)
Y_4 = UnitY(Factor=number_slider_10)

X_9 = UnitX(Factor=number_slider_10)

neg = Negative(Value=X_9)
bzspan = BezierSpan(StartPoint=pt_3, StartTangent=neg, EndPoint=pt_2, EndTangent=X_9)  # -> Curve, Length, Domain

previewlw_9 = CustomPreviewLineweights(LinesConnect=bzspan.Curve, Shader=gradient_2, Thickness="0.3", Absolute=False)

# ----
# delivery areas data
panel_16 = Panel("0.3")
justified_text_3 = JustifiedText3d(
    Location=pt_3,
    Text=concat,
    Size=panel_16,
    Color=swatch_4,
    HorizontalAlignment=0,
    VerticalAlginment=0,
    UseMeshes=False,
    Bake=False)
justified_text_4 = JustifiedText3d(
    Location=pt_3,
    Country=rev_2,
    Size=panel_16,
    Color=swatch_4,
    HorizontalAlignment=0,
    VerticalAlginment=2,
    UseMeshes=False,
    Bake=False)

series = Series(Start=0.3, Step=panel_16, Count=simplify(lng_3))

Y_5 = UnitY(Factor=series)
move_10 = Move(Geometry=graft(pt_3), Motion=expr("-x*1.5", Y_5))  # -> Geometry, Transform
justified_text_5 = JustifiedText3d(
    Location=move_10.Geometry,
    Region=split_2,
    Size=panel_16,
    Color=swatch_4,
    HorizontalAlignment=0,
    VerticalAlginment=2,
    UseMeshes=False,
    Bake=False)
